# Grasshopper definition GCode-3D.gh (Grasshopper 1.0.7)
# Copyright: Use it.  Mod it.  Share it. Just please give credit and kepp this party going.

rapid_speed_g0 = Slider(1528, range=0..3200)
print_speed_g1 = Slider(300, range=0..3200)

layer_height = Slider(1, range=0..1)
xy_tolerance = Slider(0.1, range=0..1)
z_movement_distance = Slider(5, range=0..50)
geometry_from_rhino = Geometry(<brep referenced from the Rhino model>)
pt = ConstructPoint(XCoordinate=0, YCoordinate=0, ZCoordinate=0)

# ---- group: convert geometry to perimeter curves and basic g code movements / slice geometry
contour = Contour(Shape=geometry_from_rhino, Point=pt, Direction=Vector(0, 0, 1), Distance=layer_height)

# ---- group: convert geometry to perimeter curves and basic g code movements / remap the data structure to accomadte multiple geometries
panel = Panel(contour)
path_mapper = PathMapper(contour, source="{A;B}", target="{B;A}")
panel_2 = Panel(path_mapper)

# ---- group: convert geometry to perimeter curves and basic g code movements / points to gcode
topoly = CurveToPolyline(Curve=path_mapper, ToleranceDistance=xy_tolerance, ToleranceAngle=0)  # -> Polyline, Segments
explode = Explode(Curve=topoly.Polyline, Recursive=True)  # -> Segments, Vertices
pdecon = Deconstruct(Point=explode.Vertices)  # -> XComponent, YComponent, ZComponent
format = Format(Format="G1 X{0} Y{1} ", Culture=127, Data0=pdecon.XComponent, Data1=pdecon.YComponent)

# ---- group: move to first XY position at rapid speed
item = ListItem(List=pdecon.XComponent, Index=0, Wrap=True)
item_2 = ListItem(List=pdecon.YComponent, Index=0, Wrap=True)
format_2 = Format(Format="G0 X{0} Y{1} ", Culture=127, Data0=item, Data1=item_2, Data2=rapid_speed_g0)
panel_3 = Panel(format_2)

# ---- group: move up in z at rapid speed
item_3 = ListItem(List=pdecon.ZComponent, Index=0, Wrap=True)
format_3 = Format(Format="G0 Z{0} ", Culture=127, Data0=item_3, Data1=rapid_speed_g0)
panel_4 = Panel(format_3)

# ---- group: begin printing and set print speed
item_4 = ListItem(List=format, Index="1", Wrap=True)
format_4 = Format(Format="{0} F{1}", Culture=127, Data0=item_4, Data1=print_speed_g1)
panel_5 = Panel(format_4)

# ---- group: continue printing
split = SplitList(List=format, Index="2")  # -> ListA, ListB
trim = TrimTree(Tree=split.ListB, Depth=1)
panel_6 = Panel(trim)

# ----
long = LongestList(ListA="M42", ListB=format_3, PaddingMode=2)  # -> ListA, ListB

long_2 = LongestList(ListA="M43", ListB=format_3, PaddingMode=2)  # -> ListA, ListB

format_5 = Format(Format="G0 X0 Y0 Z0 F{0}", Culture=127, Data0=rapid_speed_g0)
panel_7 = Panel(format_5)
format_6 = Format(Format="G0 Z{0} F{1}", Culture=127, Data0=Slider(55, range=0..100), Data1=rapid_speed_g0)
panel_8 = Panel(format_6)

panel_9 = Panel("G0 X{0} Y{1} F{2}")

# ---- group: move up in z at rapid speed
item_5 = ListItem(List=pdecon.ZComponent, Index=0, Wrap=True)

# ----
addition = Addition(A=item_5, B=z_movement_distance)

# ---- group: move up in z at rapid speed (continued)
format_7 = Format(Format="G0 Z{0} F{1}", Culture=127, Data0=addition, Data1=rapid_speed_g0)
panel_10 = Panel(format_7)

# ----
merge = Merge(Data2=format_7, Data3=format_2, Data4=format_3, Data5=long.ListA, Data7=format_4, Data8=trim, Data9=long_2.ListA)  # -> flatten(Result)
merge_2 = Merge(Data1=panel_7, Data2=merge, Data3=panel_8)
panel_11 = Panel(merge_2)
